# Grasshopper definition HOKware.gh (Grasshopper 1.0.7)

series = Series(Start=0, Step="10", Count=10)
vec = VectorXYZ(XComponent=series, YComponent=series, ZComponent=series)  # -> Vector, Length
box = DomainBox(Base=vec.Vector, X="5", Y="10", Z="15")
panel = Panel("""box
grasshopper""")
shoot = HOK_ExportFile(
    fileName="Boxes",
    contributorName="Devang",
    fileDescription="A bunch of boxes",
    fileTags=panel,
    targetFolder="D:\Github\repo\data",
    includeRhino=Toggle(False),
    export=Toggle(True))  # -> readMe; inputs changeLog: list, fileTags: list, includeRhino: Boolean, GHForThumb: Boolean, additionalImgs: list, export: Boolean; plug-in component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
les = Butterfly_LESTurbulenceModel(LES_model="kEqn", delta="cubeRootVol", turbulence=True, print_coeffs=True)  # -> LES; plug-in component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
exporthydra = Hydra_ExportFile()  # -> readMe; inputs fileDescription: list, changeLog: list, fileTags: list, includeRhino: Boolean, GHForThumb: Boolean, additionalImgs: list, export: Boolean; plug-in component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
