# Grasshopper definition pedestrian.gh (Grasshopper 0.9.76)
# plug-ins: Python Interpreter

ladybug = Ladybug_Ladybug()  # -> Vviiiiiiiiiizzz; plug-in component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
# Walk Path
path = Curve(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)
panel = Panel("""Pedestrian
views
Ladybug""")
panel_2 = Panel(ladybug)

# ---- group: Stand Point
eval = EvaluateCurve(Curve=reparameterize(path), Parameter=Slider(0.61, range=0..1))  # -> Point, Tangent, Angle

# ---- group: Walk
divide = DivideCurve(Curve=path, Count=Slider(10, range=0..10), Kinks=False)  # -> Points, Tangents, Parameters

# ----
exporthydra = Hydra_ExportFile(
    fileName="Pedestrian Views",
    fileDescription="A file showing views along a pedestrian route",
    fileTags=panel,
    targetFolder="D:\Github\hydra-grasshopper",
    includeRhino=Toggle(True),
    GHForThumb=Toggle(False),
    export=Toggle(False))  # -> readMe; inputs fileDescription: list, changeLog: list, fileTags: list, includeRhino: Boolean, GHForThumb: Boolean, additionalImgs: list, export: Boolean; plug-in component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
panel_3 = Panel(exporthydra)
pt = Point(eval.Point)
pl = PlaneNormal(Origin=pt, ZAxis=Vector(0, 0, 1))
brep = Brep([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])
viewrose = Ladybug_viewRose(context=brep, plane=pl, radius=Slider(90, range=0..1000))  # -> readMe, viewRose, blocked, visibleAngle; plug-in component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

# ---- group: Obstructed Views
lng = ListLength(List=viewrose.viewRose)
lng_2 = ListLength(List=viewrose.blocked)
random = Random(Range=Domain(0, 1), Number=lng, Seed=2)
random_2 = Random(Range=Domain(0, 1), Number=lng_2, Seed=random)
gradient = Gradient(
    LowerLimit=0,
    UpperLimit=1,
    Parameter=random_2,
    stops=[0: RGB(234, 38, 0), 0.25: RGB(234, 126, 0), 0.5: RGB(254, 244, 84), 0.75: RGB(173, 203, 249), 1: RGB(75, 107, 169)])
material = CreateMaterial(Diffuse=gradient, Specular=RGB(255, 255, 255), Emission=RGB(0, 0, 0), Transparency=Slider(0.5, range=0..1), Shine=0)
boundary = BoundarySurfaces(Edges=viewrose.blocked)
preview = CustomPreview(Geometry=boundary, Shader=material)

# ---- group: Views
lng_3 = ListLength(List=viewrose.viewRose)
random_3 = Random(Range=Domain(0, 1), Number=lng_3, Seed=2)
gradient_2 = Gradient(
    LowerLimit=0,
    UpperLimit=1,
    Parameter=random_3,
    stops=[0: RGB(234, 126, 0), 0: RGB(68, 9, 77), 0: RGB(254, 244, 84), 0.00219: RGBA(0, 0, 0, 0), 1: RGB(38, 143, 34), 1: RGB(173, 203, 249), 1: RGB(75, 107, 169)])
material_2 = CreateMaterial(Diffuse=gradient_2, Specular=RGB(255, 255, 255), Emission=RGB(0, 0, 0), Transparency=Slider(0.5, range=0..1), Shine=0)
boundary_2 = BoundarySurfaces(Edges=viewrose.viewRose)
preview_2 = CustomPreview(Geometry=boundary_2, Shader=material_2)
