# Grasshopper definition shadow_range.gh (Grasshopper 0.9.76)
# plug-ins: Python Interpreter, FalseStartToggle

ladybug = Ladybug_Ladybug()  # -> Vviiiiiiiiiizzz; plug-in component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
panel = Panel("https://www.energyplus.net/weather-download/north_and_central_america_wmo_region_4/USA/MA/USA_MA_Boston-Logan.Intl.AP.725090_TMY/all")
panel_2 = Panel("""shadowrange
shadows
Ladybug""")
toggle = FalseStartToggle(False)
epw_stat = Ladybug_OpenEPWAndSTATWeatherFiles(weatherFileURL=panel)  # -> epwFile, statFile; plug-in component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
exporthydra = Hydra_ExportFile(
    fileName="shadow range",
    fileDescription="A file showing how to do a shadow range study",
    fileTags=panel_2,
    targetFolder="D:\Github\hydra-grasshopper",
    includeRhino=Toggle(True),
    GHForThumb=Toggle(False),
    export=toggle)  # -> readMe; inputs fileDescription: list, changeLog: list, fileTags: list, includeRhino: Boolean, GHForThumb: Boolean, additionalImgs: list, export: Boolean; plug-in component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
importlocation = Ladybug_ImportLocation(epwFile=epw_stat.epwFile)  # -> location; plug-in component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
panel_3 = Panel(exporthydra)
series = Series(Start="8", Step=1, Count="11")
sunpath = Ladybug_SunPath(location=importlocation, hour=series, day=21, month="9", timeStep=1, sunPathScale="0.2", dailyOrAnnualSunPath=True)  # -> readMe, sunVectors, sunAltitudes, sunAzimuths, port, sunSpheresMesh, sunPathCrvs, compassCrvs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; plug-in component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
mesh = Mesh(sunpath.sunSpheresMesh)
box = DomainBox(Base=PlaneXY(0, 0, 0), X="10", Y="10", Z="25")
gradientlibrary = Ladybug_GradientLibrary(gradIndex="5")  # -> customColors; plug-in component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
toggle_2 = BooleanToggle(True)
geo = Geometry(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)
wires = BrepWireframe(Brep=box, Density=-1)
legendpar = Ladybug_LegendParameters(customColors=flatten(gradientlibrary))  # -> legendPar; plug-in component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
sunlighthoursanalysis = Ladybug_SunlightHoursAnalysis(
    geometry=flatten(geo),
    context=flatten(box),
    gridSize="1",
    disFromBase="0.01",
    sunVectors=flatten(sunpath.sunVectors),
    timeStep=1,
    legendPar=flatten(legendpar),
    parallel=toggle_2,
    runIt=toggle_2)  # -> readMe, contextMesh, analysisMesh, testPts, testVec, port, sunlightHoursResult, sunlightHoursMesh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; plug-in component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
preview = CustomPreview(Geometry=[wires, sunpath.sunPathCrvs, sunpath.compassCrvs], Shader=ColourSwatch(SwatchColor=RGB(0, 0, 0)))
mesh_2 = Mesh(sunlighthoursanalysis.sunlightHoursMesh)
