# Grasshopper definition windrose.gh (Grasshopper 0.9.76)
# plug-ins: Python Interpreter, FalseStartToggle

ladybug = Ladybug_Ladybug()  # -> Vviiiiiiiiiizzz; plug-in component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
panel = Panel("https://www.energyplus.net/weather-download/north_and_central_america_wmo_region_4/USA/MA/USA_MA_Boston-Logan.Intl.AP.725090_TMY/all")
panel_2 = Panel("""windrose
Ladybug""")
toggle = FalseStartToggle(False)
epw_stat = Ladybug_OpenEPWAndSTATWeatherFiles(weatherFileURL=panel)  # -> epwFile, statFile; plug-in component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
exporthydra = Hydra_ExportFile(
    fileName="Windrose",
    fileDescription="A file showing how to do a create a windrose",
    fileTags=panel_2,
    targetFolder="D:\Github\hydra-grasshopper",
    includeRhino=Toggle(True),
    GHForThumb=Toggle(False),
    export=toggle)  # -> readMe; inputs fileDescription: list, changeLog: list, fileTags: list, includeRhino: Boolean, GHForThumb: Boolean, additionalImgs: list, export: Boolean; plug-in component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
panel_3 = Panel(exporthydra)
importepw = Ladybug_ImportEpw(epwFile=epw_stat.epwFile)  # -> readMe, latitude, location, dryBulbTemperature, dewPointTemperature, relativeHumidity, windSpeed, windDirection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; plug-in component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
toggle_2 = BooleanToggle(True)
windrose = Ladybug_WindRose(
    north=0,
    hourlyWindDirection=importepw.windDirection,
    hourlyWindSpeed=importepw.windSpeed,
    showFrequency=toggle_2,
    showAverageVelocity=toggle_2,
    runIt=Toggle(True))  # -> readMe, calmRoseMesh, windRoseMesh, windRoseCrvs, windRoseCenPts, legend, legendBasePts, title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; plug-in component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
